# Dynamo custom node Rhythm.3DRoomTags.dyf (Dynamo 0.9.0.3067)
# category: Rhythm.Tools
# This node will generate 3D room tags for all rooms in the model. (RFA in extra folder in Dynamo download)

ThreeDRoomTag = Input(ThreeDRoomTag : FamilyType)
RunMe = Input(RunMe:bool = false)
room_element_collector = Custom[Room Element Collector](RunMe=RunMe)  # THis will collect data regarding rooms in the active model. Similar to Lunchbox node, but this one does not use python.
startPoint = Curve.StartPoint(room_element_collector.Boundaries)
byPoints = Polygon.ByPoints(startPoint)
center = Polygon.Center(byPoints)
byPoint = FamilyInstance.ByPoint(familyType=ThreeDRoomTag, point=center)
code_block = CodeBlock { "Name"; "Number"; }
setParameterByName = Element.SetParameterByName(element=byPoint, parameterName=code_block.out1, value=room_element_collector.Number)
setParameterByName_2 = Element.SetParameterByName(element=byPoint, parameterName=code_block.out0, value=room_element_collector.Name)
clean = Custom[Output.Clean](input=setParameterByName_2)  # This will return a single value or list from one input.
ThreeDRoomTags = Output(clean)
